# Grasshopper definition skin.gh (Grasshopper 0.9.76)
# plug-ins: MeshEdit Components, Kangaroo Components, Weaverbird, MeshDual, Starling

triangular_coverage = Slider(33, range=0..200)
diamond_coverage = Slider(27.2, range=0..214)

# ---- group: mesh
mesh = Mesh(<mesh referenced from the Rhino model>)

# ----
wbloop = WeaverbirdsLoopSubdivision(MeshCurves=mesh, Level=Slider(2, range=0..10), SmoothNakedEdges=1)
meshdual = MeshDual(Mesh=wbloop, Center=Slider(3, range=0..10))
crv = Curve(meshdual)
len = Length(Curve=crv)  # -> simplify(Length)
larger = LargerThan(FirstNumber=len, SecondNumber=diamond_coverage)  # -> LargerThan, OrEqualTo
dispatch = Dispatch(List=crv, DispatchPattern=larger.LargerThan)  # -> ListA, ListB
cp = ControlPoints(Curve=dispatch.ListB)  # -> Points, Weights, Knots
larger_2 = LargerThan(FirstNumber=dispatch.ListA, SecondNumber=triangular_coverage)  # -> LargerThan, OrEqualTo
hull = ConvexHull(Points=cp.Points, Plane=PlaneXY(0, 0, 0))  # -> simplify(Hull), simplify(HullZ), Indices
dispatch_2 = Dispatch(List=dispatch.ListA, DispatchPattern=larger_2.LargerThan)  # -> ListA, ListB
crv_2 = Curve(hull.HullZ)
cp_2 = ControlPoints(Curve=dispatch_2.ListA)  # -> Points, Weights, Knots
slstarmesh = SlStarMesh(Polyline=crv_2)
cp_3 = ControlPoints(Curve=dispatch_2.ListB)  # -> simplify(Points), Weights, Knots
hull_2 = ConvexHull(Points=cp_2.Points, Plane=PlaneXY(0, 0, 0))  # -> simplify(Hull), simplify(HullZ), Indices
slstarmesh_2 = SlStarMesh(Polyline=hull_2.HullZ)
pline = PolyLine(Vertices=cp_3.Points, Closed=True)
hull_3 = ConvexHull(Points=cp_3.Points, Plane=PlaneXY(0, 0, 0))  # -> simplify(Hull), simplify(HullZ), Indices
explode = MeshExplode(Mesh=slstarmesh, Interpolate=False)
wbnaked = WeaverbirdsNakedBoundary(MeshClosedPolylines=explode)
slstarmesh_3 = SlStarMesh(Polyline=hull_3.HullZ)
boundary = BoundarySurfaces(Edges=wbnaked)
explode_2 = Explode(Curve=hull_3.HullZ, Recursive=True)  # -> Segments, Vertices
area = Area(Geometry=slstarmesh_3)  # -> Area, graft(Centroid)
merge = Merge(Data1=area.Centroid, Data2=explode_2.Vertices)
duppt = RemoveDuplicatePts(Points=merge, Tolerance=0.01)
item = ListItem(List=duppt, Index=0, Wrap=True)  # -> Item, Item1, Item2, Item3, Item4, Item5, Item6
pline_2 = PolyLine(Vertices=[item.Item, item.Item1, item.Item2, item.Item3], Closed=True)
pline_3 = PolyLine(Vertices=[item.Item, item.Item5, item.Item4, item.Item3], Closed=True)
pline_4 = PolyLine(Vertices=[item.Item1, item.Item6, item.Item5, item.Item], Closed=True)
slsourcemesh = SlSourceMesh(Polyline=pline_2)
slsourcemesh_2 = SlSourceMesh(Polyline=pline_3)
slsourcemesh_3 = SlSourceMesh(Polyline=pline_4)
merge_2 = Merge(Data1=slsourcemesh, Data2=slsourcemesh_2, Data3=slsourcemesh_3)
merge_3 = Merge(Data1=pline_2, Data2=pline_3, Data3=pline_4)
cp_4 = ControlPoints(Curve=merge_3)  # -> Points, Weights, Knots
preview = CustomPreview(Geometry=slsourcemesh, Shader=ColourSwatch(SwatchColor=RGB(74, 105, 240)))
preview_2 = CustomPreview(Geometry=slsourcemesh_2, Shader=ColourSwatch(SwatchColor=RGB(121, 142, 237)))
preview_3 = CustomPreview(Geometry=slsourcemesh_3, Shader=ColourSwatch(SwatchColor=RGB(186, 199, 255)))
preview_4 = CustomPreview(Geometry=slstarmesh_2, Shader=ColourSwatch(SwatchColor=RGB(12, 39, 71)))

# ---- group: triangulate
preview_5 = CustomPreview(Geometry=slstarmesh, Shader=ColourSwatch(SwatchColor=RGB(176, 172, 189)))

# ----
hull_4 = ConvexHull(Points=cp_4.Points, Plane=PlaneXY(0, 0, 0))  # -> Hull, HullZ, Indices
number_slider = Slider(0.8, range=0..1)
number_slider_2 = Slider(0.5, range=0..1)

# ---- group: cutting shape
wbnaked_2 = WeaverbirdsNakedBoundary(MeshClosedPolylines=slsourcemesh)
wbnaked_3 = WeaverbirdsNakedBoundary(MeshClosedPolylines=slsourcemesh_2)
wbnaked_4 = WeaverbirdsNakedBoundary(MeshClosedPolylines=slsourcemesh_3)
explode_3 = Explode(Curve=[wbnaked_2, wbnaked_3, wbnaked_4], Recursive=True)  # -> Segments, Vertices
explode_4 = Explode(Curve=hull.HullZ, Recursive=True)  # -> Segments, Vertices
explode_5 = Explode(Curve=hull_2.HullZ, Recursive=True)  # -> Segments, Vertices
eval = EvaluateCurve(Curve=reparameterize(explode_3.Segments), Parameter=Slider(0.5, range=0..1))  # -> Point, Tangent, Angle
eval_2 = EvaluateCurve(Curve=reparameterize(explode_4.Segments), Parameter=number_slider_2)  # -> Point, Tangent, Angle
eval_3 = EvaluateCurve(Curve=reparameterize(explode_5.Segments), Parameter=number_slider)  # -> Point, Tangent, Angle
scale = Scale(Geometry=explode_3.Segments, Center=eval.Point, Factor=number_slider)  # -> Geometry, Transform
scale_2 = Scale(Geometry=explode_4.Segments, Center=eval_2.Point, Factor=Slider(0.8, range=0..1))  # -> Geometry, Transform
scale_3 = Scale(Geometry=explode_5.Segments, Center=eval_3.Point, Factor=number_slider_2)  # -> Geometry, Transform
